# Requirement set staqueholder (R2021b)

## 1 [ST01] Endurance (Informational)
The system shall operate at least 20 mins.

## 2 [ST02] Task (Informational)
The system shall cover the surroundings of a building.

## 3 [#3] Capabilities (Container)

### 3.1 [ST04] Altitude (Informational)
The system shall estimate its altitude to monitor its operation.

### 3.2 [ST05] Position (Informational)
The system shall estimate its position to monitor its operation.

### 3.3 [ST06] Velocity (Informational)
The system shall estimate its position to monitor its operation.

## 4 [#7] Reliability (Container)

### 4.1 [ST07] MTBR
The system shall have a Mean Time Before Repair of 1 month.

### 4.2 [ST08] MTBF
The system shall have a Mean Time Before Failure of 1 year.