# Requirement set subsystems (R2021b)

## 1 [#1] Battery (Container)

### 1.1 [BAT01] BatteryCapacity
The battery shall have a capacity of 2.5 kWh.

### 1.2 [BAT02] Battery Charging
The battery charging station shall have a minimum charging current of 2 amperes.

## 2 [#4] Structure (Container)

### 2.1 [ST01] Support
The structure shall support a maximum weight of 320 g.

## 3 [#6] Propulsion (Container)

### 3.1 [PR01] MotorPower
The motors shall have a maximum power output of at least 50 W.

### 3.2 [PR02] MotorSpeed
The motos shall have a top speed of at least 200 rpm.

## 4 [#9] Control (Container)

### 4.1 [CONT01] AltitudeEstimation
The system shall use an IMU, a camera, a sonar and a filter to estimate the altitude with an accuracy of +/- 0.15 m.

### 4.2 [CONT02] PositionEstimation
The system shall use an IMU and a camera and a Kalman filter to estimate the position with an accuracy of +/- 0.15 m.

### 4.3 [CONT03] VelocityEstimation
The system shall use an IMU and a camera and a Kalman filter to estimate the velocity.

### 4.4 [CONT04] PositionControl
The position of the drone shall have at least a PD controller.

### 4.5 [CONT05] ControllerRate
The controller shall operate at a frequency of 2 GHz.

## 5 [#15] PathGeneration (Container)

### 5.1 [PG01] PathAlgorithm
The path generation function shall create a path for the drone starting from the end position and working backwards to the drone's current position.

### 5.2 [PG02] ReplanningPath
The path generation function shall automatically generate a new path when the current path will result in an object collision.

## 6 [#18] ComponentLife

### 6.1 [CL01] CameraLife
The camera shall have a minimum life expectancy of 73 hours.

### 6.2 [CL02] IMULife
The IMU shall have a minimum life expectancy of 73 hours.

### 6.3 [CL03] SonarLife
The sonar shall have a minimum life expectancy of 73 hours.

### 6.4 [CL04] MotorLife
The motor shall have a minimum life expectancy of 2000 cycles.

### 6.5 [CL05] BatteryLife
The battery shall be able to withstand 1460 full charge/discharge cycles before needing to be replaced.

### 6.6 [CL06] ElectronicsLife
The camera shall have a minimum life expectancy of 73 hours.

### 6.7 [CL07] PropellersLife
The propellers shall have a minimum life expectancy of 30 take-off/landinglandings cicles.