# Requirement set system (R2021b)

## 1 [#1] Endurance (Container)

### 1.1 [SYS01] BatteryCapacity
The system shall have a battery capacity sufficient for 20 mins of continous operation and a weigh less than 0.5 kg.

### 1.2 [SYS02] BatteryCharging
The system shall be able to charge in maximum 2h.

### 1.3 [SYS03] MotorDistribution
The system shall be a quadcopter.

## 2 [#6] Autonomy (Container)

### 2.1 [SYS04] Localization
The system shall be able to determinate its current position within 0.3 m.

### 2.2 [SYS05] PathGeneration
The system shall automatically generate a path from its current position to a newly specified position.

### 2.3 [SYS06] PathFollowing
The system shall follow a generated path with a maximum deviation of +/- 0.3 m.

### 2.4 [SYS07] CollisionAvoidance
The system shall avoid collision during its operation.

## 3 [#11] LifeExpectancy (Container)

### 3.1 [SYS08] BatteryLife
The system battery shall be able to operate without failing for 1 year.

### 3.2 [SYS09] SensorLife
The system sensors shall be able to operate without failing for 1 year.

### 3.3 [SYS10] MechanicalLife
The system mechanical components shall be able to operate without failing for 1 year.